# Dynamo custom node Collector.AllElementTypesOf.dyf "Springs.Collector.AllElementTypesOf" (Dynamo 1.3.2.2480)
# category: Springs.Revit.Collectors
# Works with either categories, element types or revit classed . Can be applied as a function. No ties to the Document.Changed event.

CategoryOrElemType = Input(CategoryOrElemType:var)
refresh = Input(refresh:bool=true)
python_script = Python(IN[0]=CategoryOrElemType, IN[1]=refresh)
# ---------- python_script.python (26 lines) ----------
import System
import clr
clr.AddReference('RevitAPI')
from Autodesk.Revit.DB import FilteredElementCollector, Category, ElementType

clr.AddReference("RevitServices")
import RevitServices
from RevitServices.Persistence import DocumentManager
doc = DocumentManager.Instance.CurrentDBDocument

clr.AddReference('RevitNodes')
import Revit
clr.ImportExtensions(Revit.Elements)

x = UnwrapElement(IN[0])

fec = FilteredElementCollector(doc).WhereElementIsElementType()
if isinstance(x, Category):
	fec.OfCategoryId(x.Id)
elif isinstance(x, ElementType):
	fec.OfClass(x.GetType())
else:
	fec.OfClass(x)

OUT = [e.ToDSType(1) for e in fec]
fec.Dispose()
# ----------------------------------------
elements = Output(python_script)
