# Dynamo custom node Collector.ElementsInView.dyf "Springs.Collector.ElementsInView" (Dynamo 1.3.1.1736)
# category: Springs.Revit.Collectors
# Selects all elements visible in the input view.

view = Input(view:var[])
category = Input(category:var = null)
refresh = Input(refresh:bool = true)
python_script = Python(IN[0]=view, IN[1]=category, IN[2]=refresh)
# ---------- python_script.python (44 lines) ----------
# Copyright(c) 2017, Dimitar Venkov
# @5devene, dimitar.ven@gmail.com
# www.badmonkeys.net

import clr

clr.AddReference("RevitServices")
from RevitServices.Persistence import DocumentManager
doc = DocumentManager.Instance.CurrentDBDocument

clr.AddReference("RevitAPI")
from Autodesk.Revit.DB import FilteredElementCollector

clr.AddReference("RevitNodes")
import Revit
clr.ImportExtensions(Revit.Elements)

def tolist(obj1):
	if hasattr(obj1,"__iter__"): return obj1
	else: return [obj1]

views = UnwrapElement(tolist(IN[0]) )
cat = UnwrapElement(IN[1])
OUT = []

ueWrapper = None
wrappers = clr.GetClrType(Revit.Elements.ElementWrapper).GetMethods()
for w in wrappers:
	if w.ToString().startswith("Revit.Elements.UnknownElement"):
		ueWrapper = w
		break

for v in views:
	fec = FilteredElementCollector(doc, v.Id).WhereElementIsNotElementType()
	if cat is not None:
		fec = fec.OfCategoryId(cat.Id)
	viewEl = []
	for e in fec:
		try:
			viewEl.append(e.ToDSType(True) )
		except:
			if ueWrapper:
				viewEl.append(ueWrapper.Invoke(None, (e, True) ) )
	OUT.append(viewEl)
# ----------------------------------------
elements = Output(python_script)
