# Dynamo custom node Collector.FloorTypes.dyf "Springs.Collector.FloorTypes" (Dynamo 0.8.2.2392)
# category: Springs.Revit.Collectors
# Collects Floor types by name.

typeName = Input(typeName:var[])
refresh = Input(refresh:bool = true)
python_script = Python(IN[0]=typeName, IN[1]=refresh)
# ---------- python_script.python (39 lines) ----------
#Copyright(c) 2016, Dimitar Venkov
# @5devene, dimitar.ven@gmail.com

import clr

clr.AddReference("RevitServices")
import RevitServices
from RevitServices.Persistence import DocumentManager
doc = DocumentManager.Instance.CurrentDBDocument

clr.AddReference("RevitAPI")
from Autodesk.Revit.DB import *

clr.AddReference("RevitNodes")
import Revit
clr.ImportExtensions(Revit.Elements)

def tolist(obj1):
	if hasattr(obj1,"__iter__"): return obj1
	else: return [obj1]

fn = map(str,tolist(IN[0]) )
result, similar, names = [], [], []

fec = FilteredElementCollector(doc).OfClass(FloorType)
for i in fec:
	n1 = Element.Name.__get__(i)
	names.append(n1)
	if any(fn1 == n1 for fn1 in fn):
		result.append(i.ToDSType(True))
	elif any(fn1.lower() in n1.lower() for fn1 in fn):
		similar.append(i.ToDSType(True))

if len(result) > 0:
	OUT = result,similar
if len(result) == 0 and len(similar) > 0:
	OUT = "No exact match found. Check partial below:",similar
if len(result) == 0 and len(similar) == 0:
	OUT = "No match found! Check names below:", names
# ----------------------------------------
code_block = CodeBlock(a=python_script) { a[0]; a[1]; }
exact_match = Output(code_block.out0)
partial_match = Output(code_block.out1)
