# Dynamo custom node Color2Decimal.dyf (Dynamo 0.8.2.2392)
# category: SpringNodes.Revit.Colour
# Converts a Dynamo colour its Revit equivalent  decimal value.

code_block = CodeBlock()
# ---------- code_block.designscript (6 lines) ----------
def clr2dec(c){
r = c.Red;
g = c.Green;
b = c.Blue;
return = b*256*256 + g*256 + r;
};
# ----------------------------------------
color = Input()
code_block_2 = CodeBlock(c=color) { clr2dec(c); }
decimal = Output(code_block_2)
