# Dynamo custom node CurveLoop.Simplify.dyf (Dynamo 0.8.2.2392)
# category: SpringNodes.Geometry
# Attempts to simplify an open or a closed curve loop by connecting straight separate line segments into a single line.

code_block = CodeBlock()
# ---------- code_block.designscript (39 lines) ----------
def isLine(c1){
return = c1.Length == Line.ByBestFitThroughPoints
(c1.PointAtParameter({0,1})).Length;
};
def cVec(c1){
return = Vector.ByTwoPoints(c1.StartPoint,c1.EndPoint);
};
def cPts(c1){
return =c1.PointAtParameter({0,1});
};

def merge1(lines:var[]){
return = [Imperative]{
lines = PolyCurve.ByJoinedCurves(lines).Curves();
i = 0;
out1 = {};
while (i < Count(lines))
{
 pts = cPts(lines[i]);
 while (isLine(lines[i+1]) && cVec(lines[i])
 .AngleBetween(cVec(lines[i+1])) < 0.0001)
 {
  pts = List.Join({pts, cPts(lines[i+1])});
  i = i + 1;
 }
 if (Count(pts) == 2)
 {
  out1 = List.Join({out1,lines[i]});
  i = i + 1;
 }
 else
 {
  out1 = List.Join({out1,Line.ByBestFitThroughPoints(pts)});
  i = i + 1;
 }
}
return = out1;
}
};
# ----------------------------------------
curve_loop = Input()
code_block_2 = CodeBlock(lines=curve_loop) { merge1(lines); }
curve_loop_2 = Output(code_block_2)  # "curve loop"
