# Dynamo custom node Element.Copy.dyf (Dynamo 0.8.2.2392)
# category: SpringNodes.Revit.Utility
# Copy the input Revit elements with the help of a translation vector, similarly to the Geometry.Translate node.

element_s = Input()  # "element(s)"
vector_s = Input()  # "vector(s)"
python_script = Python(IN[0]=element_s, IN[1]=vector_s)
# ---------- python_script.python (61 lines) ----------
#Copyright(c) 2015, Dimitar Venkov
# @5devene, dimitar.ven@gmail.com

import clr

clr.AddReference("RevitServices")
import RevitServices
from RevitServices.Persistence import DocumentManager
from RevitServices.Transactions import TransactionManager
doc = DocumentManager.Instance.CurrentDBDocument

clr.AddReference("RevitNodes")
import Revit
clr.ImportExtensions(Revit.Elements)
clr.ImportExtensions(Revit.GeometryConversion)

clr.AddReference("RevitAPI")
from Autodesk.Revit.DB import *

clr.AddReference("System")
import System
from System.Collections.Generic import List as CList

def tolist(obj1):
	if hasattr(obj1,"__iter__"):
		return obj1
	else:
		return [obj1]

def output1(l1):
	if len(l1) == 1: return out1[0]
	else: return l1

elements = UnwrapElement(tolist(IN[0]))
vecs = tolist(IN[1])

oldId = []
for e in elements:
	try: oldId.append(e.Id)
	except: pass
oldId1 = CList[ElementId](oldId)
transforms = []
for v in vecs:
	try: transforms.append(v.ToXyz(True))
	except: pass
	
def CopyEls(oldId1, transforms):
	out1 = []
	for t in transforms:
		try:
			newId = ElementTransformUtils.CopyElements(doc, oldId1, t)
			if len(newId) == 1 :
				out1.append(doc.GetElement(newId[0]).ToDSType(False))
			else:
				for i in newId: out1.append(doc.GetElement(i).ToDSType(False))
		except: out1.append([])
	return out1
	
TransactionManager.Instance.EnsureInTransaction(doc)
OUT = output1(CopyEls(oldId1, transforms))
TransactionManager.Instance.TransactionTaskDone()
# ----------------------------------------
element_s_2 = Output(python_script)  # "element(s)"
