# Dynamo custom node Element.IsCut.dyf "Springs.Element.IsCut" (Dynamo 1.1.0.2094)
# category: Springs.Revit.Element
# Tests if the element is being cut by any void instances. If any cuts exist all cutting elements will be provided.

element = Input(element:var[])
python_script = Python(IN[0]=element)
# ---------- python_script.python (46 lines) ----------
import clr

clr.AddReference("RevitServices")
import RevitServices
from RevitServices.Persistence import DocumentManager
doc = DocumentManager.Instance.CurrentDBDocument

clr.AddReference("RevitAPI")
from Autodesk.Revit.DB import *

clr.AddReference("RevitNodes")
import Revit
clr.ImportExtensions(Revit.Elements)

def tolist(obj1):
	if hasattr(obj1,"__iter__"): return obj1
	else: return [obj1]

def output1(l1):
	if len(l1) == 1: return l1[0]
	else: return l1

elements = UnwrapElement(tolist(IN[0]))
out1 = []
cutters = []

cutU = InstanceVoidCutUtils
for i in xrange(len(elements)):
	try:
		if cutU.CanBeCutWithVoid(elements[i]):
			cut1 = cutU.GetCuttingVoidInstances(elements[i])
			if cut1.Count == 0:
				out1.append(False)
				cutters.append([])
			else:
				out1.append(True)
				cut1 = [doc.GetElement(id).ToDSType(True) for id in cut1]
				cutters.append(cut1)
		else:
			out1.append(False)
			cutters.append([])
	except:
		out1.append(False)
		cutters.append([])		

OUT = output1(out1), cutters
# ----------------------------------------
code_block = CodeBlock(res=python_script) { res[0]; res[1]; }
bool = Output(code_block.out0)
cutter = Output(code_block.out1)
