# Dynamo custom node ElementType.Duplicate.dyf "Springs.ElementType.Duplicate" (Dynamo 1.0.0.1180)
# category: Springs.Revit.ElementType
# Create duplicate element types. If the type exists, it will be appended instead.

elementType = Input(elementType:var[])
newName = Input(newName:var[])
python_script = Python(IN[0]=elementType, IN[1]=newName)
# ---------- python_script.python (49 lines) ----------
# Copyright(c) 2016, Dimitar Venkov
# @5devene, dimitar.ven@gmail.com
# www.badmonkeys.net
# based on Clockwork's node by the same name

import clr
clr.AddReference('RevitAPI')
from Autodesk.Revit.DB import *

clr.AddReference('RevitNodes')
import Revit
clr.ImportExtensions(Revit.Elements)

clr.AddReference('RevitServices')
import RevitServices
from RevitServices.Persistence import DocumentManager
from RevitServices.Transactions import TransactionManager
doc = DocumentManager.Instance.CurrentDBDocument

def tolist(x):
	if hasattr(x,'__iter__'): return x
	else : return [x]

famtypes = tolist(IN[0])
newnames = tolist(IN[1])
elementlist, fail = [],[]
func_enum = {'Revit.Elements.Material' : Revit.Elements.Material.ByName,
			 'Revit.Elements.WallType' : Revit.Elements.WallType.ByName,
			 'Revit.Elements.FloorType' : Revit.Elements.FloorType.ByName,
			 'Revit.Elements.FamilyType' : Revit.Elements.FamilyType.ByName}


ft_len = len(famtypes) == 1
TransactionManager.Instance.EnsureInTransaction(doc)
for i in xrange(len(newnames) ):
	j = 0 if ft_len else i
	try:
		elementlist.append(UnwrapElement(famtypes[j]).Duplicate(str(newnames[i]) ) )
	except:
		try:
			t1 = famtypes[j].GetType().ToString()
			if t1 in func_enum:
				elementlist.append(func_enum[t1](str(newnames[i]) ) )
			else:
				elementlist.append(fail)
		except:
			elementlist.append(fail)
TransactionManager.Instance.TransactionTaskDone()
OUT = elementlist
# ----------------------------------------
ElementType = Output(python_script)
