# Dynamo custom node FamilyInstance.Rotation.dyf (Dynamo 0.8.2.2392)
# category: SpringNodes.Revit.FamilyInstances
# Fetches the angle of rotation around the insertion point of a point based element. The angle is always measured counter-clockwise.

element_s = Input()  # "element(s)"
python_script = Python(IN[0]=element_s)
# ---------- python_script.python (22 lines) ----------
#Copyright(c) 2015, Dimitar Venkov
# @5devene, dimitar.ven@gmail.com
#Thanks for the idea Kulkul

import clr
import math
def tolist(obj1):
	if hasattr(obj1,"__iter__"):
		return obj1
	else:
		return [obj1]

elements = UnwrapElement(tolist(IN[0]))
out1 = []
for e in elements:
	try: out1.append(math.degrees(e.Location.Rotation))
	except: out1.append([])

if len(out1) == 1 :
	OUT = out1[0]
else:
	OUT = out1
# ----------------------------------------
angle = Output(python_script)
