# Dynamo custom node File.Size.dyf "Springs.File.Size" (Dynamo 1.0.0.1180)
# category: Springs.Core.File.Query
# Checks the file size. Provide a file path as a string.

path = Input(path:var[])
python_script = Python(IN[0]=path)
# ---------- python_script.python (19 lines) ----------
#Copyright(c) 2015, Dimitar Venkov
# @5devene, dimitar.ven@gmail.com

import clr
import sys
sys.path.append('C:\Program Files (x86)\IronPython 2.7\Lib')
import os

def tolist(obj1):
	if hasattr(obj1,"__iter__"): return obj1
	else: return [obj1]
def output1(l1):
	if len(l1) == 1: return l1[0]
	else: return l1

paths = tolist(IN[0])
size = [os.stat(p).st_size for p in paths]
size_f = [str(int(s)/1024) + " KB" for s in size]
OUT = output1(size_f)
# ----------------------------------------
size = Output(python_script)
