# Dynamo custom node Filter.ByClassName.dyf "Springs.Filter.ByClassName" (Dynamo 1.0.0.1180)
# category: Springs.Core.Object.Actions
# Filters a list of objects by the object's class name. Note that Dynamo elements belong to different classes than their Revit counterparts. Use the Object.Class node to check an object's class.

object = Input(object:var[])
className = Input(className:var[])
python_script = Python(IN[0]=object, IN[1]=className)
# ---------- python_script.python (22 lines) ----------
#Copyright(c) 2016, Dimitar Venkov
# @5devene, dimitar.ven@gmail.com

import clr

def tolist(obj1):
	if hasattr(obj1,"__iter__"): return obj1
	else: return [obj1]

in1,out1 = [],[]

elements = tolist(IN[0])
filter = map(str.lower, map(str,tolist(IN[1]) ) )
for i in xrange(len(elements)):
	try : n1 = elements[i].GetType().ToString().lower()
	except : n1 = "null"
	if any(f in n1 for f in filter):
		in1.append(elements[i])
	else:
		out1.append(elements[i])
	
OUT = in1, out1
# ----------------------------------------
code_block = CodeBlock(f=python_script) { f[0]; f[1]; }
in_ = Output(code_block.out0)  # "in"
out = Output(code_block.out1)
