# Dynamo custom node Filter.BySelection.dyf (Dynamo 0.8.2.2392)
# category: SpringNodes.BETA
# Check the items that you'd like to filter in.

list = Input(list:var[])
reset = Input(reset:bool = true)
python_script = Python(IN[0]=list, IN[1]=reset)
# ---------- python_script.python (103 lines) ----------
#Copyright(c) 2015, Dimitar Venkov
# @5devene, dimitar.ven@gmail.com

import clr
clr.AddReference('System.Windows.Forms')
clr.AddReference('System.Drawing')

from System.Drawing import Point
from System.Windows.Forms import Application, Button, CheckBox, Form, Label, Panel, BorderStyle

def tolist(obj1):
	if hasattr(obj1,"__iter__"): return obj1
	else: return [obj1]

class CheckBoxForm(Form):
	def __init__(self):
		self.Text = "SpringNodes: Filter By Selection"
		self.Width = 360
		self.Height = 100
		self.output1 = []
		self.output2 = []
		
		self.label = Label()
		self.label.Text = "Choose the objects you'd like to filter:"
		self.label.Location = Point(25, 5)
		self.label.AutoSize = True
		self.Controls.Add(self.label)

		self.button1 = Button()
		self.button1.Text = 'Save Selection'
		self.button1.AutoSize = True
		self.button1.Click += self.save
		self.Controls.Add(self.button1)

		self.button2 = Button()
		self.button2.Text = 'Uncheck All'
		self.button2.AutoSize = True
		self.button2.Click += self.uncheckAll
		self.Controls.Add(self.button2)

		self.button3 = Button()
		self.button3.Text = 'Check All'
		self.button3.AutoSize = True
		self.button3.Click += self.checkAll
		self.Controls.Add(self.button3)
		
		self.panel1 = Panel()
		self.panel1.Location = Point(25, 30)
		self.panel1.BorderStyle = BorderStyle.Fixed3D
		self.panel1.Width = 300
		self.Controls.Add(self.panel1)
		
	def add_check(self, text1, y1):
		self.check1 = CheckBox()
		self.check1.Text = text1
		self.check1.Location = Point(5, y1)
		self.check1.AutoSize = True
		self.check1.Checked = True
		self.panel1.Controls.Add(self.check1)
	def btn_adjust(self,y1):
		self.panel1.Height = y1
		self.button1.Location = Point(25, y1 + 50)
		self.button2.Location = Point(150, y1 + 50)
		self.button3.Location = Point(245, y1 + 50)
		self.Height = y1 + 125
		if y1 > 750:
			self.AutoScroll = True
			self.Height = 800
			
	def save(self, sender, event):
		ctrl1 = self.panel1.Controls
		count1 = ctrl1.Count
		loc = 0
		for i in xrange(count1):
			if ctrl1[i].Checked == 1:
				self.output1.append(l1[loc])
			else:
				self.output2.append(l1[loc])
			loc += 1
		self.Close()
	def uncheckAll(self, sender, event):
		ctrl1 = self.panel1.Controls
		count1 = ctrl1.Count
		for i in xrange(count1):
			ctrl1[i].Checked = False
	def checkAll(self, sender, event):
		ctrl1 = self.panel1.Controls
		count1 = ctrl1.Count
		for i in xrange(count1):
			ctrl1[i].Checked = True

l1 = tolist(IN[0])

form = CheckBoxForm()
y1 = 5
for i in l1: 
	try: form.add_check(str(i), y1) ; y1 += 25
	except: pass
form.btn_adjust(y1)

Application.Run(form)
OUT = form.output1, form.output2
Application.Exit()
# ----------------------------------------
code_block = CodeBlock(o=python_script) { o[0]; o[1]; }
in_ = Output(code_block.out0)  # "in"
out = Output(code_block.out1)
