# Dynamo custom node FloorOpening.ByCurves.dyf "Springs.FloorOpening.ByCurves" (Dynamo 1.2.1.3083)
# category: Springs.Revit.Opening
# Create hosted floor opeinngs through the input floors. The second input is a list of sub-lists of the boundary curves.

host = Input(host:var[])
curves = Input(curves:var[][])
python_script = Python(IN[0]=host, IN[1]=curves)
# ---------- python_script.python (55 lines) ----------
#Copyright(c) 2016, Dimitar Venkov
# @5devene, dimitar.ven@gmail.com

import clr

clr.AddReference("RevitAPI")
from Autodesk.Revit.DB import *

clr.AddReference("RevitServices")
import RevitServices
from RevitServices.Persistence import DocumentManager
from RevitServices.Transactions import TransactionManager
doc =  DocumentManager.Instance.CurrentDBDocument

clr.AddReference("RevitNodes")
import Revit
clr.ImportExtensions(Revit.Elements)
clr.ImportExtensions(Revit.GeometryConversion)

def tolist(obj1):
	if hasattr(obj1,"__iter__"): return obj1
	else: return [obj1]

def output1(l1):
	if len(l1) == 1: return l1[0]
	else: return l1

flr = UnwrapElement(tolist(IN[0]))
hole = UnwrapElement(IN[1])

openings = []
newhl = []
if not any(hasattr(h,"__iter__") for h in hole):
	hole = [hole]
TransactionManager.Instance.EnsureInTransaction(doc)
for i in xrange(len(hole)):
	z = CurveArray()
	[z.Append(j.ToRevitType()) for j in hole[i] ]
	newhl.append(z)
if len(flr) == 1 :
	for i in xrange(len(newhl)):
		try:
			x = doc.Create.NewOpening(flr[0],newhl[i],True)
			openings.append(x.ToDSType(False))
		except:
			openings.append(None)
else:
	for f, h in zip(flr, newhl):
		try:
			x = doc.Create.NewOpening(f,h,True)
			openings.append(x.ToDSType(False))
		except:
			openings.append(None)
TransactionManager.Instance.TransactionTaskDone()
OUT = output1(openings)
# ----------------------------------------
opening = Output(python_script)
