# Dynamo custom node Form.ByGeometry.dyf (Dynamo 0.8.2.2392)
# category: SpringNodes.Revit.Forms
# Attempts to convert the input geometry to a Revit Form object. Warning - use method this only in the family environment. Can convert complicated solids or surfaces directly into forms.

geometry = Input()
python_script = Python(IN[0]=geometry)
# ---------- python_script.python (46 lines) ----------
import clr

clr.AddReference("RevitServices")
import RevitServices
from RevitServices.Persistence import DocumentManager
from RevitServices.Transactions import TransactionManager
doc = DocumentManager.Instance.CurrentDBDocument

clr.AddReference("RevitNodes")
import Revit
clr.ImportExtensions(Revit.Elements)
clr.ImportExtensions(Revit.GeometryConversion)

clr.AddReference("RevitAPI")
import Autodesk

clr.AddReference("System")
from System.Collections.Generic import *

_solid_ = IN[0]
if doc.IsFamilyDocument:
	el1 = UnwrapElement(Revit.Elements.ImportInstance.ByGeometry(_solid_))
	TransactionManager.Instance.EnsureInTransaction(doc)
	trans = Autodesk.Revit.DB.SubTransaction(doc)
	trans.Start()
	opt1 = Autodesk.Revit.DB.Options()
	opt1.ComputeReferences = True
	geom1 = el1.get_Geometry(opt1)
	enum = geom1.GetEnumerator()
	enum.MoveNext()
	geom2 = enum.Current.GetInstanceGeometry()
	enum2 = geom2.GetEnumerator()
	enum2.MoveNext()
	s1 = enum2.Current
	try:
		s2 = Autodesk.Revit.DB.FreeFormElement.Create(doc,s1)
		OUT = s2.ToDSType(False)
	except:
		OUT = None
	trans.Commit()
	trans.Start()
	doc.Delete(el1.Id)
	trans.Commit()
	TransactionManager.Instance.TransactionTaskDone()
else:
	OUT = "Forms can only exist in family documents"
# ----------------------------------------
Form = Output(python_script)
