# Dynamo custom node Fraction2Feet.dyf "Springs.Fraction2Feet" (Dynamo 1.0.0.1180)
# category: Springs.Core.Units
# Converts a fractioned feet /inch string value into a decimal foot value.

code_block = CodeBlock()
# ---------- code_block.designscript (40 lines) ----------
def frac2ft(s1){
n1 = 0;
n2 = 0;
n3 = 0;
n4 = 0;
 return = [Imperative]
 {
  s0 = null;
  if(String.Contains(s1,"'",true))
  {
   s0 = String.Split(s1,{"'"});
   n1 = String.ToNumber(s0[0]);
   s1 = s0[1];
  }
  if(String.Contains(s1," ",true))
  {
   s0 = String.Split(s1,{" "});
   n2 = String.ToNumber(s0[0])/12;
   s1 = s0[1];
  }
  if(String.Contains(s1,"/",true))
  {
   s0 = String.Split(s1,{"/"});
   n3 = String.ToNumber(s0[0]);
   n4 = String.ToNumber(
   String.Split(s0[1],{"\""})[0]);
  }
  elseif(!String.Contains(s1,"/",true))
  {
   n2 = String.ToNumber(
   String.Split(s1,{"\""})[0])/12;
  }
  n5 = 0;
  if (n3 != 0 && n4 != 0)
  {
   n5 = (n3/n4)/12;
  }
  return = n1 + n2 + n5;
 }
};
# ----------------------------------------
fraction = Input(fraction:var)
code_block_2 = CodeBlock(s1=fraction) { frac2ft(s1); }
number = Output(code_block_2)
