# Dynamo custom node Geometry.Extents.dyf "Springs.Geometry.Extents" (Dynamo 1.0.0.1180)
# category: Springs.Geometry
# Gets the dimensions of the geometry's bounding box.

geometry = Input(geometry:var)
code_block = CodeBlock(geometry)
# ---------- code_block.designscript (11 lines) ----------
def size1(g){
bb = BoundingBox.ByGeometry(g);
min = bb.MinPoint;
max = bb.MaxPoint;
w = Math.Abs(min.X - max.X);
l = Math.Abs(min.Y - max.Y);
h = Math.Abs(min.Z - max.Z);
return = {w, l, h};
};

size1(obj);
# ----------------------------------------
code_block_2 = CodeBlock(r=code_block) { r[0]; r[1]; r[2]; }
width = Output(code_block_2.out0)
length = Output(code_block_2.out1)
height = Output(code_block_2.out2)
