# Dynamo custom node Geometry.SplitRecursively.dyf "Springs.Geometry.SplitRecursively" (Dynamo 0.8.2.2392)
# category: Springs.Geometry
# Splits a surface or a solid recursively, using the resulting reduced geometry for every consecutive split. Select a point or another geometry to control the direction of the split.

code_block = CodeBlock()
# ---------- code_block.designscript (20 lines) ----------
def splitface1(face, planes:var[],dir1){
return = [Imperative]{
 out1 = {};
 for (p in planes){
  s1 = face.Split(p);
  if(Count(s1) < 2){
   face = s1[0];
   continue;
  }
  ind1 = SortIndexByValue(
   dir1.DistanceTo(s1) );
  s1 = Reorder(s1,ind1);
  face = s1[0];
  s2 = s1[1];
  out1 = List.AddItemToEnd(s2,out1);
 }
 out1 = List.AddItemToEnd(face,out1);
 return = List.Clean(out1, false);
}
};
# ----------------------------------------
geometry = Input(geometry:var)
tools = Input(tools:var[])
pickPoint = Input(pickPoint:var)
code_block_2 = CodeBlock(face=geometry, tools=tools, dir1=pickPoint) { splitface1(face, tools,dir1); }
geometry_2 = Output(code_block_2)  # "geometry[]"
