# Dynamo custom node HostedInstance.ByPoints.dyf "Springs.HostedInstance.ByPoints" (Dynamo 1.1.0.2094)
# category: Springs.Revit.FamilyInstance
# Creates hosted family instances(doors/windows) at the specified points. You can feed either a single family type or a unique type for each instance.

host = Input(host: var[])
type = Input(type: var[])
point = Input(point: var[])
python_script = Python(IN[0]=host, IN[1]=type, IN[2]=point)
# ---------- python_script.python (51 lines) ----------
#Copyright(c) 2016, Dimitar Venkov
# @5devene, dimitar.ven@gmail.com

import clr

clr.AddReference("RevitServices")
import RevitServices
from RevitServices.Persistence import DocumentManager
from RevitServices.Transactions import TransactionManager
doc = DocumentManager.Instance.CurrentDBDocument

clr.AddReference("RevitAPI")
import Autodesk

clr.AddReference("RevitNodes")
import Revit
clr.ImportExtensions(Revit.Elements)
clr.ImportExtensions(Revit.GeometryConversion)

def tolist(obj1):
	if hasattr(obj1,"__iter__"): return obj1
	else: return [obj1]
def output1(l1):
	if len(l1) == 1: return l1[0]
	else: return l1

host = UnwrapElement(tolist(IN[0]))
ftype = UnwrapElement(tolist(IN[1]))
fpts = UnwrapElement(tolist(IN[2]))

Rpts =[p.ToXyz(True) for p in fpts]

nfl = []
strt = Autodesk.Revit.DB.Structure.StructuralType.NonStructural
ftp_len = len(ftype) == 1
hst_len = len(host) == 1

TransactionManager.Instance.EnsureInTransaction(doc)
for i in xrange(len(Rpts) ):
	j = 0 if ftp_len else i
	k = 0 if hst_len else i
	try:
		if not ftype[j].IsActive : ftype[j].Activate()
		level = doc.GetElement(host[k].LevelId)
		nf = doc.Create.NewFamilyInstance(Rpts[i],ftype[j],host[k],level,strt)
		nfl.append(nf.ToDSType(False))
	except:
		nfl.append(None)
TransactionManager.Instance.TransactionTaskDone()

OUT = output1(nfl)
# ----------------------------------------
FamilyInstance = Output(python_script)
