# Dynamo custom node Line.StraightenZ.dyf (Dynamo 3.3.0.6316)
# category: Springs.Geometry.Actions
# Checks a line's end points for irregularities in  the Z axis and corrects them if they are at or below the specified margin. The default margin is 1/5000 of the curve length, which is conservative.

line = Input(line: var)
margin = Input(margin: double = 5000)
code_block = CodeBlock(c=line, x=margin)
# ---------- code_block.designscript (15 lines) ----------
straightened = [Imperative]{
margin = c.Length / x;
cS = c.StartPoint;
cE = c.EndPoint;
dZ = DSCore.Math.Abs(cS.Z - cE.Z);
if (dZ <= margin)
{
	return = DesignScript.Line.ByStartPointEndPoint(
	cS,DesignScript.Point.ByCoordinates(cE.X, cE.Y, cS.Z));
}
else
{
	return = c;
}
};
# ----------------------------------------
line_2 = Output(code_block)  # "line"
