# Dynamo custom node LineLoop.Merge.dyf "Springs.LineLoop.Merge" (Dynamo 1.1.0.2094)
# category: Springs.Geometry
# Attempts to join lines into a single chain of joined curves. The node returns the new lines as a chain and with the original order. The success outputs returns the success of the execution as a true/false boolean.

lines = Input(lines:var[])
margin = Input(margin:double = 100)
python_script = Python(IN[0]=lines, IN[1]=margin)
# ---------- python_script.python (76 lines) ----------
#Copyright(c) 2016, Dimitar Venkov
# @5devene, dimitar.ven@gmail.com

import clr

clr.AddReference('ProtoGeometry')
from Autodesk.DesignScript.Geometry import *

curves = IN[0]
margin = IN[1]
original = curves[:]

def OrderCurves(cl0,cl1):
	def countTrue(l1, n = 0):
		for i in l1: n += 1 if i else 0
		return n

	def switch1(i, j, cl0 = cl0, cl1 = cl1):
		cl0[i],cl0[j] = cl0[j],cl0[i]
		cl1[i],cl1[j] = cl1[j],cl1[i]

	_ln = len(cl1)
	xr1 =  xrange(_ln)
	int_test = [[cl1[i].DoesIntersect(cl1[j])\
	for j in xr1 if j != i] for i in xr1]
	countT = map(countTrue, int_test)
	if 0 not in countT:
		if 1 in countT and countT[0] != 1 :
			switch1(0, countT.index(1) )
		for i in xrange(_ln - 1):
			k = i + 1
			if cl1[i].DoesIntersect(cl1[k]) : pass
			else :
				try:
					int_test = [cl1[i].DoesIntersect(cl1[j])\
					for j in xrange(k, _ln)]
					switch1(k, k + int_test.index(True) )
				except : pass
	return cl0, cl1

def ClosedCase(cl0,cl1):
	pts = [cl1[i-1].Intersect(cl1[i])[0] for i in xrange(len(cl1) )]
	return PolyCurve.ByPoints(pts,True).Curves()

def OpenCase(cl0,cl1):
	def FarPt(l1, p1):
		pts = (l1.StartPoint,l1.EndPoint)
		return max(pts, key = p1.DistanceTo)

	pts = [cl1[i].Intersect(cl1[i+1])[0] for i in xrange(len(cl1) -1)]
	pts.append(FarPt(cl0[-1],pts[-1]))
	pts.insert(0,FarPt(cl0[0],pts[0]))
	return PolyCurve.ByPoints(pts).Curves()

def joinCurves(cl0,th1):
	len1 = len(cl0)
	if len1 < 2 : return cl0, False
	else:
		cl1 = [c.ExtendStart(th1).ExtendEnd(th1) for c in cl0]
		cl0, cl1 = OrderCurves(cl0,cl1)
		_fn = ClosedCase if cl1[0].DoesIntersect(cl1[-1]) and len1 > 2 else OpenCase
		try : return _fn(cl0,cl1), True
		except : return cl0, False

def ReorderCurves(orig, new):
	reordered, new = [], list(new)
	app1, pop1, PaP = reordered.append, new.pop, Curve.PointAtParameter
	for i in xrange(len(orig) ):
		p1 = PaP(orig[i],0.5)
		p2 = [PaP(new[j],0.5) for j in xrange(len(new) )]
		ind1 = p2.index(min(p2, key = p1.DistanceTo) )
		app1(pop1(ind1) )
	return reordered

out1 = joinCurves(curves, margin)
OUT = out1[0], ReorderCurves(original,out1[0]), out1[1]
# ----------------------------------------
code_block = CodeBlock(o=python_script) { o[0]; o[1]; o[2]; }
lines_2 = Output(code_block.out0)  # "lines"
ordered = Output(code_block.out1)
success = Output(code_block.out2)
