# Dynamo custom node List.DropDown.dyf (Dynamo 0.8.2.2392)
# category: SpringNodes.BETA
# Select one item from the list from a drop-down combo box.

list = Input(list:var[])
reset = Input(reset:bool = true)
python_script = Python(IN[0]=list, IN[1]=reset)
# ---------- python_script.python (52 lines) ----------
#Copyright(c) 2015, Dimitar Venkov
# @5devene, dimitar.ven@gmail.com

import clr
clr.AddReference('System.Windows.Forms')
clr.AddReference('System.Drawing')

from System.Drawing import Point
from System.Windows.Forms import Application, Button, Form, ComboBox
from System import Array, Object

def tolist(obj1):
	if hasattr(obj1,"__iter__"): return obj1
	else: return [obj1]

class DropDownForm(Form):
	def __init__(self):
		self.Text = "SpringNodes: Drop-Down Selection"
		self.Width = 360
		self.Height = 120
		
		self.combo1 = ComboBox()
		self.combo1.Location = Point(25, 15)
		self.combo1.Width = 300
		self.combo1.MouseClick += self.expand
		self.Controls.Add(self.combo1)
		
		self.button1 = Button()
		self.button1.Text = 'Select'
		self.button1.AutoSize = True
		self.button1.Location = Point(25, 50)
		self.button1.Click += self.save
		self.Controls.Add(self.button1)
	
	def expand(self, sender, event):
		self.combo1.DroppedDown = True
	def add_range(self,l1):
		self.combo1.Items.AddRange(l1)	
		if l1.Length >= 1:
			self.combo1.SelectedIndex = 0
	def save(self, sender, event):
		self.output1 = self.combo1.SelectedItem
		self.Close()

l1 = tolist(IN[0])

l1_arr = Array[Object](l1)
form = DropDownForm()
form.add_range(l1_arr)
Application.Run(form)
OUT = form.output1
Application.Exit()
# ----------------------------------------
selection = Output(python_script)
