# Dynamo custom node List.FilterBySelection.dyf (Dynamo 4.0.2.3852)
# category: Springs.Actions
# Check the items that you'd like to filter in.  Unchecked items will be sent to the out list. The optional names input will override the object representation.

list = Input(list: var[]..[])
names = Input(names: var[]..[] = null)
customMsg = Input(customMsg: string = "Choose the objects you'd like to filter:")
checkAll = Input(checkAll: bool = false)
reset = Input(reset: bool = true)
python_script = Python(IN[0]=list, IN[1]=names, IN[2]=customMsg, IN[3]=checkAll, IN[4]=reset)  # PythonNet3
# ---------- python_script.python (180 lines) ----------
#-Reope----------------------------------------#
#                                              #
#      Copyright(c) 2017, Dimitar Venkov       #
#                                              #
# https://github.com/dimven/SpringNodes/issues #
# https://www.reope.com/                       #
#                                              #
#    ____    _____   _____   ____    _____     #
#   |  _ \ *|  ___|*|  _  |*|  _ \ *|  ___|    #
#   | |_) |*| |___ *| | | |*| |_) |*| |___     #
#   |  _ < *|  ___|*| | | |*|  __/ *|  ___|    #
#   | | | |*| |___ *| |_| |*| |    *| |___     #
#   |_| \_|*|_____|*|_____|*|_|    *|_____|    #
#                                              #
#                                              #
#-Reope-----Updated by Mark Ackerley-----------#

import clr
clr.AddReference('System.Windows.Forms')
clr.AddReference('System.Drawing')
from System.Drawing import Point, Color, Font
from System.Windows.Forms import *

def tolist(obj1):
    if isinstance(obj1, str): return [obj1]
    return obj1 if isinstance(obj1, list) else [obj1]

def hasInd(l1, i):
    try: l1[i]; return True
    except: return False

class CheckBoxForm(Form):
    def __init__(self, cm1):
        super().__init__()
        self.Text = "SpringNodes: Filter By Selection"
        self.Width = 450
        self.BackColor = Color.FromArgb(40, 40, 40)
        self.output1 = None
        self.ControlBox = True
        self.TopMost = True
        self.FormBorderStyle = FormBorderStyle.Sizable
        self.Resize += self.on_resize
        self.StartPosition = FormStartPosition.CenterScreen
        self.FormClosing += self.DisableForceClose

        self.label = Label()
        self.label.Text = cm1
        self.label.Location = Point(5, 5)
        self.label.ForeColor = Color.FromArgb(234, 234, 234)
        self.label.Font = Font("Calibri", 10)
        self.label.AutoSize = True
        self.Controls.Add(self.label)

        self.button1 = Button()
        self.button1.Text = 'Save Selection'
        self.button1.ForeColor = Color.FromArgb(234, 234, 234)
        self.button1.Font = Font("Calibri", 10)
        self.button1.Click += self.save
        self.Controls.Add(self.button1)

        self.button2 = Button()
        self.button2.Text = 'Uncheck All'
        self.button2.ForeColor = Color.FromArgb(234, 234, 234)
        self.button2.Font = Font("Calibri", 10)
        self.button2.Click += self.uncheckAll
        self.Controls.Add(self.button2)

        self.button3 = Button()
        self.button3.Text = 'Check All'
        self.button3.ForeColor = Color.FromArgb(234, 234, 234)
        self.button3.Font = Font("Calibri", 10)
        self.button3.Click += self.checkAll
        self.Controls.Add(self.button3)

        self.panel1 = Panel()
        self.panel1.Width = self.Width - 20
        self.panel1.Location = Point(5, 31)
        self.panel1.BackColor = Color.FromArgb(53, 53, 53)
        self.panel1.ForeColor = Color.FromArgb(234, 234, 234)
        self.Controls.Add(self.panel1)
        
        self.panel1.Anchor = AnchorStyles.Top | AnchorStyles.Bottom | AnchorStyles.Left | AnchorStyles.Right
        self.button1.Anchor = AnchorStyles.Bottom | AnchorStyles.Left
        self.button2.Anchor = AnchorStyles.Bottom | AnchorStyles.Left
        self.button3.Anchor = AnchorStyles.Bottom | AnchorStyles.Left #

    def add_check(self, text1, y1, b1, obj1):
        self.check1 = CheckBox()
        self.check1.Text = text1
        self.check1.Location = Point(5, y1)
        self.check1.Width = self.panel1.Width - 10
        self.check1.AutoSize = False
        self.check1.Font = Font("Calibri", 10)
        self.check1.Checked = b1
        self.check1.Anchor = AnchorStyles.Top | AnchorStyles.Left | AnchorStyles.Right
        self.panel1.Controls.Add(self.check1)
        self.check1.Tag = obj1 

    def btn_adjust(self, y1):
        if y1 > 700:
            y1 = 700
            self.panel1.AutoScroll = True
            self.panel1.Focus()
            
        panel_height = self.Height - 150
        if panel_height > 0:
            self.panel1.Height = panel_height
            self.panel1.Width = self.Width - 20
        btn_width = (self.Width - 40) // 3
        self.button1.Width = btn_width
        self.button2.Width = btn_width
        self.button3.Width = btn_width
        self.button1.Location = Point(5, y1 + 38)
        self.button2.Location = Point(5 + btn_width + 5, y1 + 38)
        self.button3.Location = Point(5 + (btn_width + 5) * 2, y1 + 38)
        self.Height = y1 + 120
        
    def on_resize(self, sender, event):
        self.panel1.Width = self.Width - 20
        btn_width = (self.Width - 40) // 3
        self.button1.Width = btn_width
        self.button2.Width = btn_width
        self.button3.Width = btn_width
        self.button1.Location = Point(5, self.panel1.Height + 38)
        self.button2.Location = Point(5 + btn_width + 5, self.panel1.Height + 38)
        self.button3.Location = Point(5 + (btn_width + 5) * 2, self.panel1.Height + 38)

    def save(self, sender, event):
        ctrl1 = self.panel1.Controls
        self.output1 = [c.Tag for c in ctrl1 if c.Checked]
        self.Close()

    def uncheckAll(self, sender, event):
        ctrl1 = self.panel1.Controls
        count1 = ctrl1.Count
        for i in range(count1):
            ctrl1[i].Checked = False

    def checkAll(self, sender, event):
        ctrl1 = self.panel1.Controls
        count1 = ctrl1.Count
        for i in range(count1):
            ctrl1[i].Checked = True

    def DisableForceClose(self, sender, event):
        if self.output1 is None:
            self.output1 = None

try:
    l1 = tolist(IN[0])
    if IN[1] is None: names = None
    else: names = tolist(IN[1])

    form = CheckBoxForm(IN[2])
    y1 = 5
    for i in range(len(l1)):
        try:
            if hasInd(names, i):
                candidate = names[i]
                val1 = candidate if isinstance(candidate, str) else str(l1[i])
            else:
                val1 = str(l1[i])
            form.add_check(val1, y1, IN[3], l1[i])
            y1 += 25
        except: pass
    form.btn_adjust(y1)

    form.ShowDialog()

    if form.output1 is None:
        OUT = "No selection"
    else:
        OUT = form.output1

except Exception as e:
    import traceback
    OUT = "Exception:\n{0}\n\nTraceback:\n{1}".format(
        str(e),
        traceback.format_exc()
    )
# ----------------------------------------
bool = Output(python_script)
