# Dynamo custom node List.GetEven.dyf (Dynamo 0.8.2.2392)
# category: SpringNodes.Lists
# Gets even indices from the list.

list = Input(list:var[])
code_block = CodeBlock(l1=list) { List.TakeEveryNthItem(l1,2,0); }
list_2 = Output(code_block)  # "list"
