# Dynamo custom node List.GetEvenOdd.dyf "Springs.List.GetEvenOdd" (Dynamo 1.1.0.2094)
# category: Springs.Core.List
# Gets even indices from the list.

list = Input(list:var[])
code_block = CodeBlock(l1=list) { List.TakeEveryNthItem(l1,2,0); List.DropEveryNthItem(l1,2,0); }
even = Output(code_block.out0)
odd = Output(code_block.out1)
