# Dynamo custom node List.GetOdd.dyf (Dynamo 0.8.2.2392)
# category: SpringNodes.Lists
# Gets the odd indices from the list.

list = Input(list:var[]..[])
code_block = CodeBlock(l1=list) { List.DropEveryNthItem(l1,2,0); }
list_2 = Output(code_block)  # "list"
