# Dynamo custom node List.MergeByBoolMask.dyf "Springs.List.MergeByBoolMask" (Dynamo 1.3.2.2480)
# category: Springs.Core.List
# Merge two lists by a boolean mask list. The true count in the mask should be the same as the length of the true list and vice versa for the false list.

mask = Input(mask:var[]..[])
In = Input(In:var[]..[])
Out = Input(Out:var[]..[])
python_script = Python(IN[0]=mask, IN[1]=In, IN[2]=Out)
# ---------- python_script.python (14 lines) ----------
# Copyright(c) 2017, Dimitar Venkov
# @5devene, dimitar.ven@gmail.com
# www.badmonkeys.net

def tolist(obj1):
	if hasattr(obj1,'__iter__'): return obj1
	else: return [obj1]

t1 = tolist(IN[0])
l1 = list(reversed(tolist(IN[1]) ) )
l2 = list(reversed(tolist(IN[2]) ) )

try: OUT = [l1.pop() if i else l2.pop() for i in t1]
except Exception as e: OUT = str(e)
# ----------------------------------------
list = Output(python_script)
