# Dynamo custom node List.MinIndex.dyf (Dynamo 2.0.2.6826)
# category: Springs.List
# Gets the minimum index of a list. Good for use with loating point values

list = Input(list: var[])
python_script = Python(IN[0]=list)
# ---------- python_script.python (6 lines) ----------
def tolist(x):
	if hasattr(x,'__iter__'): return x
	return [x]

data = tolist(IN[0])
OUT = min(enumerate(data), key=lambda x: x[1])
# ----------------------------------------
code_block = CodeBlock(r=python_script) { r[0]; r[1]; }
idx = Output(code_block.out0)
val = Output(code_block.out1)
