# Dynamo custom node List.Randomise&Divide.dyf "Springs.List.Randomise&Divide" (Dynamo 1.0.0.1180)
# category: Springs.Core.List
# Shiffles the input list and divides it into sub-lists based on ratios(1/4 + 1/2 + 1/4 will give you three lists split accordingly) The smalest ratio will always be 1 / the list length and the largest ratio will be 1. A seed input can shuffle the list further.

code_block = CodeBlock()
# ---------- code_block.designscript (25 lines) ----------
def RandSplit(l1:var[],ratio:var[],seed)
{
 return = [Imperative]
 {
 len = Count(l1);
 l2 = List.Shuffle(l1);
 out1 = {};
 start = 0;
 end = -1;
 i = 0;
 if (Math.Sum(ratio) < 1)
 {
  ratio = List.AddItemToEnd(
  1 - Math.Sum(ratio),ratio);
 }
 for (r in ratio)
 {
  end = end + Math.Ceiling(r*len);
  out1[i] = l2[start..end];
  i = i + 1;
  start = end + 1;
 }
 return = List.Clean(out1,false);
 }
};
# ----------------------------------------
list = Input(list:var[])
ratios = Input()
seed = Input(seed:double = 1)
code_block_2 = CodeBlock(l1=list, ratios=ratios, seed=seed) { RandSplit(l1,ratios,seed); }
lists = Output(code_block_2)
code_block_3 = CodeBlock()  # //add rest of ratios
