# Dynamo custom node List.Subpairs.dyf "Springs.List.Subpairs" (Dynamo 1.2.1.3083)
# category: Springs.Core.List
# Pair up each list item with the next one and drop the list item.

list = Input(list:var[]..[])
code_block = CodeBlock(l1=list)
# ---------- code_block.designscript (2 lines) ----------
DSCore.List.DropItems(DSCore.
List.Sublists(l1,0..1,1),-1);
# ----------------------------------------
lists = Output(code_block)
