# Dynamo custom node Ln2Str.dyf "Springs.Ln2Str" (Dynamo 1.1.0.2094)
# category: Springs.Geometry.Serialization
# Serilize a geometry line to a string for use in Revit parameters

line = Input(line:var)
separator = Input(separator: string = ",")
code_block = CodeBlock(line, separator)
# ---------- code_block.designscript (11 lines) ----------
def Pt2Rvt(p1, s1)
{
return = p1.X + s1 + p1.Y + s1 + p1.Z;
};

def Ln2Rvt(l1, s1)
{
return = Pt2Rvt(l1.StartPoint, s1) + s1 + Pt2Rvt(l1.EndPoint, s1);
};

Ln2Rvt(cl, s1);
# ----------------------------------------
string = Output(code_block)
