# Dynamo custom node Mesh.ToPolySurface.dyf "Springs.Mesh.ToPolySurface" (Dynamo 1.3.1.1736)
# category: Springs.Geometry
# Converts a Dynamo mesh to a polysurface. Uses multithreading - optimized for 4 cores.

mesh = Input(mesh:var[])
mergeAll = Input(mergeAll : bool = false)
python_script = Python(IN[0]=mesh, IN[1]=mergeAll)
# ---------- python_script.python (54 lines) ----------
#Copyright(c) 2016, Dimitar Venkov
# @5devene, dimitar.ven@gmail.com
import clr
from System.Threading import Thread, ThreadStart
from operator import itemgetter

clr.AddReference('ProtoGeometry')
from Autodesk.DesignScript.Geometry import *

def tolist(obj1):
	if hasattr(obj1,'__iter__'): return obj1
	else: return [obj1]

def chop1(l1, n):
	return [l1[x:x+n] for x in xrange(0, len(l1), n)]

def mesh2ps(topo, f_chop = chop1, itemgetter=itemgetter, 
			f_ps1 = PolySurface.ByJoinedSurfaces):
	vp = topo.VertexPositions
	ptslist = [itemgetter(i.A, i.B, i.C)(vp) for i in topo.FaceIndices]
	len1 = int(round(len(ptslist) ) ) / 4 + 1
	surf = [None, None, None, None]

	def ps_generator(i, ptslist,
					 chop1=chop1,
					 f_ps1 = PolySurface.ByJoinedSurfaces,
					 f_sf1 = Surface.ByPerimeterPoints):
		sflist = [f_sf1(pts) for pts in ptslist[i] ]
		while len(sflist) > 10 :
			sflist = chop1(sflist, 10)
			sflist = [f_ps1(sf1) for sf1 in sflist]
		surf[i] = sflist
		return
	if len(ptslist) > 7 :
		ptslist = f_chop(ptslist, len1)
		def threaded_ps0(): return ps_generator(0, ptslist)
		def threaded_ps1(): return ps_generator(1, ptslist)
		def threaded_ps2(): return ps_generator(2, ptslist)
		def threaded_ps3(): return ps_generator(3, ptslist)
		threads = (Thread(ThreadStart(threaded_ps0) ),
				   Thread(ThreadStart(threaded_ps1) ),
				   Thread(ThreadStart(threaded_ps2) ),
				   Thread(ThreadStart(threaded_ps3) ) )
		for t in threads: t.Start()
		for t in threads: t.Join()
		return f_ps1(surf[0] + surf[1] + surf[2] + surf[3])
	else:
		ps_generator(0, (ptslist, ) )
		return  f_ps1(surf[0])
		
meshes = tolist(IN[0])
OUT = map(mesh2ps,meshes)
if IN[1]:
	OUT = PolySurface.ByJoinedSurfaces(OUT)
# ----------------------------------------
PolySurface = Output(python_script)
