# Dynamo custom node Mesh.ToToolkitMesh.dyf "Springs.Mesh.ToToolkitMesh" (Dynamo 1.0.0.1180)
# category: Springs.Geometry
# Converts a Dynamo mesh to a toolkit mesh. You obviously need to have the appropriate version of the mesh toolkit package downloaded first.

mesh = Input(mesh:var)
code_block = CodeBlock(mesh)
# ---------- code_block.designscript (7 lines) ----------
def Mesh2Mesh(m1){
vp = m1.VertexPositions;
fi = m1.FaceIndices;
fi2 = Flatten(List.Transpose({fi.A,fi.B,fi.C}));
return = Dynamo.Mesh.ByVerticesAndIndices(vp,fi2);
};
Mesh2Mesh(m1);
# ----------------------------------------
toolkitMesh = Output(code_block)
