# Dynamo custom node NullAllIndicesOf.dyf "Springs.NullAllIndicesOf" (Dynamo 1.2.1.3083)
# category: Springs.Core.List
# list all of the indices of a list that match the specified value. Capable of handling null values, part of the SmartCopyMonitor workflow.

list = Input(list:var[])
value = Input(value:var)
code_block = CodeBlock(list, value)
# ---------- code_block.designscript (17 lines) ----------
def NullAllInd(l1:var[],val)
{
return = [Imperative]
{
out1 = {};
for(i in GetKeys(l1))
{
if(l1[i] == val)
{
out1 = Flatten({out1, i});
}
}
return = out1;
}
};

NullAllInd(l1,val);
# ----------------------------------------
indices = Output(code_block)
