# Dynamo custom node NullGetParameter.dyf (Dynamo 0.8.1.1942)
# category: SpringNodes.SmartCopyMon
# Similar to the built in node.Capable of handling null values, part of the SmartCopyMonitor workflow.

element = Input()
parameter = Input()
code_block = CodeBlock(element, parameter)
# ---------- code_block.designscript (12 lines) ----------
def NullGetPar(e1,par)
{
return = [Imperative]
{
if (e1 != null)
{
val = e1.GetParameterValueByName(par);
return = val;
}
}
};
NullGetPar(e1,par);
# ----------------------------------------
value = Output(code_block)
