# Dynamo custom node NullIndexOf.dyf "Springs.NullIndexOf" (Dynamo 1.3.2.2480)
# category: Springs.Core.List
# Similar to the bult-in node but provides a null value instead of -1 of failure. Part of the SmartCopyMonitor workflow.

list = Input(list:var[])
element = Input(element:var)
code_block = CodeBlock(l1=list, el1=element) { ind0 = IndexOf(l1,el1); ind1 = ind0 == -1 ? null : ind0; }
index = Output(code_block.ind1)
