# Dynamo custom node NullSetParameter.dyf (Dynamo 0.8.1.1942)
# category: SpringNodes.SmartCopyMon
# Similar to the built-in function but with the ability to handle null values. Part of the SmartCopyMon workflow.

element = Input()
parameter = Input()
value = Input()
code_block = CodeBlock(element, parameter, value)
# ---------- code_block.designscript (12 lines) ----------
def NullSet(e1,par,val)
{
return = [Imperative]
{
if (e1 != null)
{
e1.SetParameterByName(par,val);
return = e1;
}
}
};
NullSet(e1,par,val);
# ----------------------------------------
element_2 = Output(code_block)  # "element"
