# Dynamo custom node Points.ConvexHull2D.dyf "Springs.Points.ConvexHull2D" (Dynamo 1.1.0.2094)
# category: Springs.Geometry
# Computes the XY convex hull of a given set of points based on the monotone chain algorithm.

points = Input(points:var[])
elevation = Input(elevation:double = 0)
python_script = Python(IN[0]=points, IN[1]=elevation)
# ---------- python_script.python (26 lines) ----------
import clr
clr.AddReference('ProtoGeometry')
from Autodesk.DesignScript.Geometry import *

def ps1(p): return p.X
def ps2(p): return p.Y
pts = sorted(sorted(IN[0], key = ps1), key = ps2)
elev = IN[1]

def pCrs(o, a, b):
	return (a.X - o.X) * (b.Y - o.Y) - (a.Y - o.Y) * (b.X - o.X)

pLen = len(pts)
if pLen <= 1 : OUT = pts
else:
	lower, upper = [], []
	for i in xrange(pLen):
		j = pLen - 1 - i
		while len(lower) >= 2 and pCrs(lower[-2], lower[-1], pts[i]) <= 0:
			lower.pop()
		lower.append(pts[i])
		while len(upper) >= 2 and pCrs(upper[-2], upper[-1], pts[j]) <= 0:
			upper.pop()
		upper.append(pts[j])
	pts2 = lower[:-1] + upper[:-1]
	OUT = [Point.ByCoordinates(p.X, p.Y, elev) for p in pts2]
# ----------------------------------------
points_2 = Output(python_script)  # "points"
