# Dynamo custom node Polygon.2DArea.dyf "Springs.Polygon.2DArea" (Dynamo 1.2.1.3083)
# category: Springs.Geometry
# Returns the planar area of the input polygon(s).

polygon = Input(polygon:var[])
python_script = Python(IN[0]=polygon)
# ---------- python_script.python (35 lines) ----------
# Copyright(c) 2017, Dimitar Venkov
# @5devene, dimitar.ven@gmail.com
# www.badmonkeys.net

def tolist(obj1):
	if hasattr(obj1,'__iter__'): return obj1
	else: return [obj1]

def output1(x):
	if len(x) == 1: return x[0]
	else : return x

#https://stackoverflow.com/questions/2432428/is-there-any-algorithm-for-calculating-area-of-a-shape-given-co-ordinates-that-d

polys = tolist(IN[0])
area = []
for p in polys:
	t1 = p.GetType().ToString()
	if 'Polygon' in t1:
		pts = p.Points
	elif 'PolyCurve' in t1:
		pts = [c.StartPoint for c in p.Curves()]
	else:
		area.append(None)
		continue
	a = 0
	l1 = len(pts)
	for i in xrange(l1):
		j = i + 1
		if j == l1:
			j = 0
		a += pts[i].X * pts[j].Y
		a -=  pts[i].Y * pts[j].X
	area.append(abs(a/2.0) )
OUT = output1(area)
# ----------------------------------------
area = Output(python_script)
