# Dynamo custom node Polygon.ContainmentTest+.dyf "Springs.Polygon.ContainmentTest+" (Dynamo 0.8.2.2392)
# category: Springs.Geometry
# A less accurate method that should perform faster than the built-in node for large data sets.

points = Input(points:var[])
polygon = Input(polygon:var)
python_script = Python(IN[0]=points, IN[1]=polygon)
# ---------- python_script.python (37 lines) ----------
#Copyright(c) 2016, Dimitar Venkov
# @5devene, dimitar.ven@gmail.com

import clr

def tolist(obj1):
	if hasattr(obj1,'__iter__'): return obj1
	else: return [obj1]

def is_CCW(A,B,C): return (B.X - A.X) * (C.Y - A.Y) > (B.Y - A.Y) * (C.X - A.X)

def containment(poly,pt):
	wn = 0
	for i in xrange(len(poly)-1):
		if poly[i].Y <= pt.Y:
			if poly[i+1].Y > pt.Y and is_CCW(poly[i], poly[i+1],pt): wn += 1
		else:
			if poly[i+1].Y <=pt.Y and not is_CCW(poly[i], poly[i+1],pt): wn -= 1
	if wn != 0 : return True
	else : return False

pts = tolist(IN[0])
poly = IN[1]
in1, out1 = [],[]

if "Polygon" in poly.GetType().ToString():
	poly_pts = list(poly.Points)
else:
	poly_pts = [c.StartPoint for c in poly.Curves()]
poly_pts.append(poly_pts[0])
polyX = poly.DoesIntersect

for i in xrange(len(pts)):
	if containment(poly_pts,pts[i]) or polyX(pts[i]): in1.append(pts[i])
	else: out1.append(pts[i])

OUT = in1, out1
# ----------------------------------------
code_block = CodeBlock(r=python_script) { r[0]; r[1]; }
in_ = Output(code_block.out0)  # "in"
out = Output(code_block.out1)
