# Dynamo custom node Pt2Str.dyf "Springs.Pt2Str" (Dynamo 1.1.0.2094)
# category: Springs.Geometry.Serialization
# Serilize a geometry point to a string for use in Revit parameters

point = Input(point:var)
separator = Input(separator: string = ",")
code_block = CodeBlock(point, separator)
# ---------- code_block.designscript (6 lines) ----------
def Pt2Rvt(p1, s1)
{
return = p1.X + s1 + p1.Y + s1 + p1.Z;
};

Pt2Rvt(pts, s1);
# ----------------------------------------
string = Output(code_block)
