# Dynamo custom node Quads.ByPointMatrix.dyf "ꟿ Quads.ByPointMatrix" (Dynamo 2.0.2.6826)
# category: Springs.Geometry.Actions
# Creates a CCW or CW list of quad pairs from a rectangular nested list of points.

points = Input(points: var[][])
CCW = Input(CCW: bool = true)
code_block = CodeBlock(pts=points, ccw=CCW)
# ---------- code_block.designscript (30 lines) ----------
pts;
ccw;
outp = [Imperative]{
quads = [];
u = Count(pts) - 2;
v = Count(pts[0]) - 2;
u1 = u + 1;
for (i in 0..u)
{
	for (j in 0..v)
	{
		n = u1 * j + i;
		if (ccw)
		{
			quads[n] = [pts[i][j],
						pts[i][j+1],
						pts[i+1][j+1],
						pts[i+1][j]];
		}
		else
		{
			quads[n] = [pts[i][j],
						pts[i+1][j],
						pts[i+1][j+1],
						pts[i][j+1]];
		}
	}
}
return = quads;
};
# ----------------------------------------
quads = Output(code_block.out2)
