# Dynamo custom node ScopeBox.Geometry.dyf (Dynamo 4.2.1.5887)
# category: Springs.Revit.Query
# Fetches the base curve and solid representation of a scope box element.

scopeBox = Input(scopeBox: var)
code_block = CodeBlock(s=scopeBox)
# ---------- code_block.designscript (8 lines) ----------
c1 = s.Geometry();
msk = Vector.ZAxis().Dot(c1.Direction) == 0;
c2 = DSCore.List.FilterByBoolMask(c1, msk)["in"];
c3 = DSCore.List.SortByKey(c2, c2.EndPoint.Z);
c4 = c3["sorted list"];
c5 = c4 == null ? c3["sortedList"] : c4;
pc1 = Autodesk.DesignScript.Geometry.PolyCurve.ByJoinedCurves(c5[0..3]);
s1 = pc1.ExtrudeAsSolid(c5[4].EndPoint.Z - c5[0].EndPoint.Z);
# ----------------------------------------
polyCurve = Output(code_block.pc1)
solid = Output(code_block.s1)
