# Dynamo custom node SelectInRevit.dyf (Dynamo 0.8.2.2392)
# category: SpringNodes.Revit.Selection
# Selects the input elements in Revit. Works with Revit 2016.

element_s = Input()  # "element(s)"
reset = Input(reset:bool = true)
python_script = Python(IN[0]=element_s, IN[1]=reset)
# ---------- python_script.python (49 lines) ----------
#Copyright(c) 2016, Dimitar Venkov
# @5devene, dimitar.ven@gmail.com
#inspired by Julien Benoit @jbenoit44 
#http://aecuandme.wordpress.com/

import clr

clr.AddReference("RevitServices")
import RevitServices
from RevitServices.Persistence import DocumentManager
from RevitServices.Transactions import TransactionManager
doc = DocumentManager.Instance.CurrentDBDocument
app = DocumentManager.Instance.CurrentUIApplication.Application
uidoc=DocumentManager.Instance.CurrentUIApplication.ActiveUIDocument

clr.AddReference("RevitNodes")
import Revit
clr.ImportExtensions(Revit.Elements)

clr.AddReference("RevitAPI")
from Autodesk.Revit.DB import ElementId
clr.AddReference("RevitAPIUI")
from Autodesk.Revit.UI.Selection import *

clr.AddReference("System")
from System.Collections.Generic import List as cList

def tolist(obj1):
	if hasattr(obj1,"__iter__"): return obj1
	else: return [obj1]

elements = UnwrapElement(tolist(IN[0]))

if app.VersionName == "Autodesk Revit 2014":
	TransactionManager.Instance.EnsureInTransaction(doc)
	sel1  = uidoc.Selection.Elements
	for i in xrange(len(elements)): 
		try:(sel1.Add(elements[i]))
		except: pass
	OUT = "%s elements selected in Revit." %sel1.Size
	TransactionManager.Instance.TransactionTaskDone()
else:
	ids1 = []
	for i in xrange(len(elements)):
		try:(ids1.append(elements[i].Id))
		except: pass
	ids2 = cList[ElementId](ids1)
	uidoc.Selection.SetElementIds(ids2)
	OUT = "%s elements selected in Revit." %ids2.Count
# ----------------------------------------
success = Output(python_script)  # "success?"
