# Dynamo custom node SelectLinkedElement.dyf "Springs.SelectLinkedElement" (Dynamo 0.8.2.2392)
# category: Springs.Revit.Selection
# Select the linked instance first, followed by the element. If your selection fails, just press escape.
# To refresh the node, connect a boolean switch node.

refresh = Input(refresh:bool = true)
python_script = Python(IN[0]=refresh)
# ---------- python_script.python (26 lines) ----------
#Copyright(c) 2016, Dimitar Venkov
# @5devene, dimitar.ven@gmail.com

import clr

clr.AddReference("RevitAPIUI")
from  Autodesk.Revit.UI import *

clr.AddReference("RevitServices")
import RevitServices
from RevitServices.Persistence import DocumentManager
doc = DocumentManager.Instance.CurrentDBDocument
uidoc=DocumentManager.Instance.CurrentUIApplication.ActiveUIDocument

clr.AddReference("RevitNodes")
import Revit
clr.ImportExtensions(Revit.Elements)

sel1 = uidoc.Selection
ot1 = Selection.ObjectType.Element
ot2 = Selection.ObjectType.LinkedElement
li_ref = sel1.PickObject(ot1, "Select a link instance first.")
el_ref = sel1.PickObject(ot2, "Pick a linked element.")
Link1 = doc.GetElement(li_ref.ElementId)
LinkDoc = Link1.GetLinkDocument()
OUT = LinkDoc.GetElement(el_ref.LinkedElementId).ToDSType(True)
# ----------------------------------------
element = Output(python_script)
