# Dynamo custom node SelectLinkedElements(ordered).dyf "Springs.SelectLinkedElements(ordered)" (Dynamo 0.8.2.2392)
# category: Springs.Revit.Selection
# Select the linked instance first. Then select multiple elements from the Revit document in the desired order. Hit ESC to stop picking. To refresh the node, connect a boolean switch node.

refresh = Input(refresh:bool = true)
python_script = Python(IN[0]=refresh)
# ---------- python_script.python (44 lines) ----------
#Copyright(c) 2016, Dimitar Venkov
# @5devene, dimitar.ven@gmail.com

#inspired by Troy Gates https://forums.autodesk.com/t5/revit-api/revit-api-selected-element-set-order/td-p/5597203

import clr

clr.AddReference("RevitAPIUI")
from  Autodesk.Revit.UI import *

clr.AddReference("RevitServices")
import RevitServices
from RevitServices.Persistence import DocumentManager
doc = DocumentManager.Instance.CurrentDBDocument
uidoc=DocumentManager.Instance.CurrentUIApplication.ActiveUIDocument

def output1(l1):
	if len(l1) == 1: return l1[0]
	else: return l1

clr.AddReference("RevitNodes")
import Revit
clr.ImportExtensions(Revit.Elements)

sel1 = uidoc.Selection
obt1 = Selection.ObjectType.Element
obt2 = Selection.ObjectType.LinkedElement
out1 = []

TaskDialog.Show("Spring Nodes", "First select a link instance. Then pick elements from that instance in the desired order. Hit ESC to stop picking.")
msg1 = 'Pick elements in the desired order, hit ESC to stop picking.'

li_ref = sel1.PickObject(obt1, "Select a link instance first.")
Link1 = doc.GetElement(li_ref.ElementId)
LinkDoc = Link1.GetLinkDocument()

flag = True
while flag:
	try:
		el1 = sel1.PickObject(obt2, msg1).LinkedElementId
		out1.append(el1)
	except : flag = False
out1 = [LinkDoc.GetElement(el).ToDSType(True) for el in out1]
OUT = output1(out1)
# ----------------------------------------
elements = Output(python_script)
