# Dynamo custom node SelectLinkedElements.dyf "Springs.SelectLinkedElements" (Dynamo 0.8.2.2392)
# category: Springs.Revit.Selection
# Select the linked instance first, followed by the elements. To finish the selection, press Finish. If your selection fails, just press escape or Cancel.
# To refresh the node, connect a boolean switch node.

refresh = Input(refresh:bool = true)
python_script = Python(IN[0]=refresh)
# ---------- python_script.python (27 lines) ----------
#Copyright(c) 2016, Dimitar Venkov
# @5devene, dimitar.ven@gmail.com

import clr

clr.AddReference("RevitAPIUI")
from  Autodesk.Revit.UI import *

clr.AddReference("RevitServices")
import RevitServices
from RevitServices.Persistence import DocumentManager
doc = DocumentManager.Instance.CurrentDBDocument
uidoc=DocumentManager.Instance.CurrentUIApplication.ActiveUIDocument

clr.AddReference("RevitNodes")
import Revit
clr.ImportExtensions(Revit.Elements)

sel1 = uidoc.Selection
ot1 = Selection.ObjectType.Element
ot2 = Selection.ObjectType.LinkedElement
li_ref = sel1.PickObject(ot1, "Select a link instance first.")
el_ref = sel1.PickObjects(ot2, "Select the linked elements and press Finish.")
Link1 = doc.GetElement(li_ref.ElementId)
LinkDoc = Link1.GetLinkDocument()
Lel_id = [r1.LinkedElementId for r1 in el_ref]
OUT = [LinkDoc.GetElement(id1).ToDSType(True) for id1 in Lel_id]
# ----------------------------------------
element_s = Output(python_script)  # "element(s)"
