# Dynamo custom node Sheet.Views+.dyf "Springs.Sheet.Views+" (Dynamo 1.1.0.2094)
# category: Springs.Revit.Views
# Extracts all views and schedules (minus the revision schedule) placed on the input sheet (or sheets).
# Will be depreciated once the bult in node works with all plan types.

sheet = Input(sheet: var[])
python_script = Python(IN[0]=sheet)
# ---------- python_script.python (45 lines) ----------
#Copyright(c) 2016, Dimitar Venkov
# @5devene, dimitar.ven@gmail.com

import clr

clr.AddReference("RevitServices")
from RevitServices.Persistence import DocumentManager
doc = DocumentManager.Instance.CurrentDBDocument

clr.AddReference("RevitNodes")
import Revit
clr.ImportExtensions(Revit.Elements)

clr.AddReference("RevitAPI")
from Autodesk.Revit.DB import *

def tolist(obj1):
	if hasattr(obj1,"__iter__"): return obj1
	else: return [obj1]

def output1(l1):
	if len(l1) == 1: return l1[0]
	else: return l1

sheets = UnwrapElement(tolist(IN[0]))
sheet_views, sheets_scheds = [], []
rev_str = "<Revision Schedule>"
sched_dict = dict()
fec1 = FilteredElementCollector(doc).OfClass(ScheduleSheetInstance)
for s in fec1:
	if rev_str not in s.Name:
		key = s.OwnerViewId.IntegerValue
		if key not in sched_dict:
			sched_dict[key] = [s]
		else:
			sched_dict[key].append(s)

for i in xrange(len(sheets) ):
	viewsid = sheets[i].GetAllPlacedViews()
	views = [doc.GetElement(v).ToDSType(True) for v in viewsid]
	sheet_views.append(views)
	s_id = sheets[i].Id.IntegerValue
	scheds = sched_dict[s_id] if s_id in sched_dict else []
	sheets_scheds.append(scheds)
OUT = output1(sheet_views), output1(sheets_scheds)
# ----------------------------------------
code_block = CodeBlock(o=python_script) { o[0]; o[1]; }
view_s = Output(code_block.out0)  # "view(s)"
schedule_s = Output(code_block.out1)  # "schedule(s)"
