# Dynamo custom node Star.ByCenterRadiusRays.dyf (Dynamo 0.8.1.1942)
# category: SpringNodes.Geometry
# Fun little node to create star shapes.

StarOrigin = Input(StarOrigin:Point)
StarRadius = Input(StarRadius:double)
RayPercentage = Input(RayPercentage:double)
NumberOfRays = Input(NumberOfRays:int)
code_block = CodeBlock(p1=StarOrigin, r1=StarRadius, s=RayPercentage, n=NumberOfRays) { star1(p1,r1,s,n); }
PolyCurve = Output(code_block)
code_block_2 = CodeBlock()
# ---------- code_block_2.designscript (12 lines) ----------
def star1(p1,r1,s,n)
{
c1 = Circle.ByCenterPointRadius(p1,r1);
c2 = Circle.ByCenterPointRadius(p1,r1*(99.9-s)/100);
pts1 = c1.PointAtParameter(0..1..#n+1);
//testR = n % 2 == 0;
pts2a = c2.PointAtParameter(0..1..#n*2+1);
pts2b = List.TakeEveryNthItem(pts2a,2,0);
pts3 = Flatten(List.Transpose({pts1,pts2b}));
pts3c = List.DropItems(pts3,-1);
return = PolyCurve.ByPoints(pts3c);
};
# ----------------------------------------
