# Dynamo custom node Str2Pt.dyf "Springs.Str2Pt" (Dynamo 0.8.2.2392)
# category: Springs.Geometry.Serialization
# De-serilize a Revit parameter string into a geometric point.

str = Input(str:var)
code_block = CodeBlock(str)
# ---------- code_block.designscript (6 lines) ----------
def Rvt2Pt(par)
{
par1 = String.ToNumber(String.Split(par,","));
return = Point.ByCoordinates(par1[0],par1[1],par1[2]);
};
Rvt2Pt(str);
# ----------------------------------------
point_s = Output(code_block)  # "point(s)"
