# Dynamo custom node String.ReplaceIllegalChars.dyf "Springs.String.ReplaceIllegalChars" (Dynamo 1.2.2.373)
# category: Springs.Core.String
# Replaces all characters in a string that are found in a commonly known list of illegal characters

str = Input(str:var[])
replacement = Input(replacement: string = "_")
python_script = Python(IN[0]=str, IN[1]=replacement)
# ---------- python_script.python (20 lines) ----------
# Copyright(c) 2017, Dimitar Venkov
# @5devene, dimitar.ven@gmail.com
# www.badmonkeys.net

from itertools import imap, repeat
import System
badChars = set(System.IO.Path.GetInvalidFileNameChars() )

def tolist(x):
	if hasattr(x,'__iter__'): return x
	else : return [x]

def fixName(n, rep="", badChars=badChars):
	n1 = (c if c not in badChars else rep for c in iter(n) )
	return ''.join(n1)

names = tolist(IN[0])
replacement = str(IN[1])

OUT = map(fixName, imap(str, names), repeat(replacement, len(names) ) )
# ----------------------------------------
str_2 = Output(python_script)  # "str"
