# Dynamo custom node String.RightSplitOnce.dyf (Dynamo 4.0.2.3852)
# category: Springs.Actions
# Gets the tail of a string

str = Input(str: string)
splitChar = Input(splitChar: string)
code_block = CodeBlock(s=str, spl=splitChar) { slen = String.Length(s); lastInd = String.LastIndexOf(s,spl)+1; String.Substring(s, lastInd, slen - lastInd); }
str_2 = Output(code_block.out2)  # "str"
