# Dynamo custom node Topography.ToPolySurface(py).dyf (Dynamo 0.8.2.2392)
# category: SpringNodes.Revit.Topography
# Python implementation that should boost performance by 5-10%. Optimized algorithm for converting topographies into polysurfaces. Tested with topographies containing up to 40 000 points.
# Warning conversions of such mangitudes consume a lot of resources and are sub-optimal. Ensure that you have at least 8GB of ram and plenty of patience before attempting such a conversion, otherwise your Dynamo and Revit instances may crash.

topography = Input(topography:Topography)
python_script = Python(IN[0]=topography)
# ---------- python_script.python (21 lines) ----------
import clr
clr.AddReference('ProtoGeometry')
from Autodesk.DesignScript.Geometry import *

topo = IN[0].Mesh

def chop1(l1, n):
	return [l1[x:x+n] for x in xrange(0, len(l1), n)]

def mesh2ps(topo, f_ps1 = PolySurface.ByJoinedSurfaces,
f_sf1 = Surface.ByPerimeterPoints, f_chop = chop1):
	vp = topo.VertexPositions
	fi = topo.FaceIndices
	ind = [[fi[j].A, fi[j].B, fi[j].C] for j in xrange(len(fi))]
	ptslist = [[vp[ind[i][j]] for j in xrange(len(ind[i]))] for i in xrange(len(ind))]
	sflist = [f_sf1(pts) for pts in ptslist]
	while len(sflist) > 10 :
		sflist = f_chop(sflist,10)
		sflist = [f_ps1(sf1) for sf1 in sflist]
	return f_ps1(sflist)
OUT = mesh2ps(topo)
# ----------------------------------------
polysurface = Output(python_script)
