# Dynamo graph DirectShape.ByGeometry sample.dyn (Dynamo 0.8.2.2392)

categories = Categories("GenericModel")
code_block = CodeBlock { "My car"; }
code_block_2 = CodeBlock()
# ---------- code_block_2.designscript (10 lines) ----------
r1 = Rectangle.ByWidthLength(3000,4000);
pts1 = r1.Points;
cpt = r1.Center();
s1 = Sphere.ByCenterPointRadius(pts1,800);
s2 = Sphere.ByCenterPointRadius(cpt,1700).
Translate(Vector.ByCoordinates(0,0,500));
s3 = s2.Scale(Plane.XY(),1,2,0.8);
c1 = Cuboid.ByLengths(2500,2000,1500).
Translate(Vector.ByCoordinates(0,1000,1500));
solid = s3.UnionAll(Flatten({s1,c1}));
# ----------------------------------------
identity = Object.Identity(code_block_2.solid)
byGeometry = Custom[DirectShape.ByGeometry](category=categories, name=code_block, geometry=identity)  # Attempts to create a DirectShape element inside the Revit document. It is based on an alternative process that uses a SAT inport and can produce smooth surfaces.
code_block_3 = CodeBlock { "Comments"; "This is my car!"; }
setParameterByName = Element.SetParameterByName(element=byGeometry, parameterName=code_block_3.out0, value=code_block_3.out1)
