# Dynamo graph FamilyInstance.ByGeometry sample.dyn (Dynamo 0.8.2.2392)

code_block = CodeBlock()
# ---------- code_block.designscript (15 lines) ----------
/*
You must provide a valid family template path that will be used for all input
geometry objects. The project units(and not the templates) will be used to
determine the size of the output geometry.
The provided category will be used only if the family template supports it.
If not, the default template category will be used instead.
Likewise, the family material(provided as a string) will be set only if a
material with that name exists in the template. If not, the default material
will be used instead ("By Category").
For void cuts, the material settings will be ignored.
The output is the resulting family and an instance aligned according to the
project document's origin. The node expects a unique family name for each
geometry object. The rest of the input lists will be processed as if the node
lacing is set to longest.
*/;
# ----------------------------------------
code_block_2 = CodeBlock()
# ---------- code_block_2.designscript (8 lines) ----------
Rectangle.ByWidthLength(10000,6000).Points;
3..6;
1500..1000..#4;
3000;
Cuboid.ByLengths(11000,6500,500).Translate
(Vector.ByCoordinates(0,0,2500));
Sphere.ByCenterPointRadius(Point.ByCoordinates
({-1300,500,1200},{-900,700,-1800},2300..3000..#3),1000);
# ----------------------------------------
n_hedron_byoriginvector = Custom[N-hedron.ByOriginVector](origin=code_block_2.out0, sides=code_block_2.out1, length=code_block_2.out2, height=code_block_2.out3)  # Creates a multi-sided poyhedron with defined side length and total height.
join = List.Join(n_hedron_byoriginvector, code_block_2.out4, code_block_2.out5)
file_path = Filename("C:\ProgramData\Autodesk\RVT 2015\Family Templates\English\Metric Generic Model.rft")
code_block_3 = CodeBlock { "Super Family " + (1..8); }
categories = Categories("StructuralColumns")
code_block_4 = CodeBlock { 4; }
ofRepeatedItem = List.OfRepeatedItem(item=categories, amount=code_block_4)
categories_2 = Categories("StructuralFraming")
categories_3 = Categories("GenericModel")
join_2 = List.Join(ofRepeatedItem, categories_2, categories_3)
code_block_5 = CodeBlock { Flatten({List.Cycle("Earth",4),"Glass"}); Flatten({List.Cycle(false,5),true}); }
byGeometry = Custom[FamilyInstance.ByGeometry](geometry=join, family_template_path=file_path, family_name=code_block_3, category=join_2, material_name=code_block_5.out0, isVoid=code_block_5.out1)  # You must provide a valid family template path that will be used for all input geometry objects. The project units(and not the templates) will be used to determine the size of the output geometry. The provided category will be used only if the family template supports it. If not, the default template category will be used instead. Likewise, the family material(provided as a string) will be set only if a material with that name exists in the template. If not, the default material will be used instead ("By Category"). For void cuts, the material settings will be ignored. The output is the resulting family and an instance aligned according to the project document's origin. The node expects a unique family name for each geometry object. The rest of the input lists will be processed as if the node lacing is set to longest.
watch = Watch(byGeometry)
code_block_6 = CodeBlock()  # //now cut the cuboid with the three new voids
code_block_7 = CodeBlock()
# ---------- code_block_7.designscript (3 lines) ----------
//be sure to pick a family template( like the
//generic model family) that's the same version
//as your Revit instance
# ----------------------------------------
