# Dynamo graph Form.ByGeometry sample.dyn (Dynamo 0.8.2.2392)

code_block = CodeBlock()
# ---------- code_block.designscript (10 lines) ----------
r1 = Rectangle.ByWidthLength(3000,4000);
pts1 = r1.Points;
cpt = r1.Center();
s1 = Sphere.ByCenterPointRadius(pts1,800);
s2 = Sphere.ByCenterPointRadius(cpt,1700).
Translate(Vector.ByCoordinates(0,0,500));
s3 = s2.Scale(Plane.XY(),1,2,0.8);
c1 = Cuboid.ByLengths(2500,2000,1500).
Translate(Vector.ByCoordinates(0,1000,1500));
solid = s3.UnionAll(Flatten({s1,c1}));
# ----------------------------------------
identity = Object.Identity(code_block.solid)
byGeometry = Custom[Form.ByGeometry](geometry=identity)  # Attempts to convert the input geometry to a Revit Form object. Warning - use method this only in the family environment. Can convert complicated solids or surfaces directly into forms.
code_block_2 = CodeBlock { "Material"; Material.ByName("Glass"); }
setParameterByName = Element.SetParameterByName(element=byGeometry, parameterName=code_block_2.out0, value=code_block_2.out1)
code_block_3 = CodeBlock()
# ---------- code_block_3.designscript (3 lines) ----------
//make sure you're inside a family document
//foe example, try the Conceptual Mass environment
//unlike a DirectShape, it's easy to change a form's material
# ----------------------------------------
