# Dynamo graph HostedInstance sample.dyn (Dynamo 0.8.2.2392)

# group: multiple windows on a single wall example
select_model_element = DSModelElementSelection()  # 1 picked in the model
watch = Watch(select_model_element)
location = Custom[Element.Location](element=select_model_element)  # Returns the location of an element as an XYZ (or if it's line-based the start and end point of the line), along with some booleans to help filtering the results. Use this for some element types (e.g. walls or lines) that do not work with the built-in Get Family Instance Location node.
code_block = CodeBlock { 0.3..0.9..0.2; }
pointAtParameter = Curve.PointAtParameter(curve=location.curves, param=code_block, lacing=Longest)
count = Count(pointAtParameter)
ofRepeatedItem = List.OfRepeatedItem(item=select_model_element, amount=count)
family_types = FamilyTypes("M_Window-Square Opening:0900 x 1800mm")
byPoints = Custom[HostedInstance.ByPoints](host_s=ofRepeatedItem, type_s=family_types, point_s=pointAtParameter)  # Creates hosted family instances(doors/windows) at the specified points. You can feed either a single family type or a unique type for each instance.
code_block_2 = CodeBlock { "Sill Height"; 800; }
setParameterByName = Element.SetParameterByName(element=byPoints, parameterName=code_block_2.out0, value=code_block_2.out1)
code_block_3 = CodeBlock()  # //from clockwork
code_block_4 = CodeBlock()  # //each window needs a host

# group: multiple windows on multiple walls example
select_model_elements = DSModelElementsSelection()  # 2 picked in the model
pointAtParameter_2 = Curve.PointAtParameter(lacing=Longest)
location_2 = Custom[Element.Location](element=select_model_elements)
code_block_5 = CodeBlock { {0.3..0.9..0.2,{0.4,0.6}}; }
combine = List.Combine(pointAtParameter_2, location_2.curves, code_block_5)
count_2 = Count(combine, lacing=Longest)
ofRepeatedItem_2 = List.OfRepeatedItem(item=select_model_elements, amount=count_2, lacing=Longest)
flatten = Flatten(ofRepeatedItem_2)
family_types_2 = FamilyTypes("M_Window-Square Opening:0900 x 1800mm")
flatten_2 = Flatten(combine)
byPoints_2 = Custom[HostedInstance.ByPoints](host_s=flatten, type_s=family_types_2, point_s=flatten_2)
code_block_6 = CodeBlock { "Sill Height"; 800; }
setParameterByName_2 = Element.SetParameterByName(element=byPoints_2, parameterName=code_block_6.out0, value=code_block_6.out1)
code_block_7 = CodeBlock()  # //each window needs a host
watch_2 = Watch(select_model_elements)
code_block_8 = CodeBlock()  # //default value for param is disabled
