# Dynamo graph Instance.ByGeometry.dyn (Dynamo 4.0.2.3852)

code_block = CodeBlock { 2; }
byLengths = Cuboid.ByLengths(width=code_block)
list_create = List.Create(item0=byLengths, item1=byLengths)
code_block_2 = CodeBlock { 2; }
byLengths_2 = Cuboid.ByLengths(length=code_block_2)
code_block_3 = CodeBlock { 2; }
byLengths_3 = Cuboid.ByLengths(height=code_block_3)
list_create_2 = List.Create(item0=byLengths_3, item1=byLengths_3, item2=byLengths_3)
code_block_4 = CodeBlock { 2; }
byLengths_4 = Cuboid.ByLengths(length=code_block_4)
empty = List.Empty()
code_block_5 = CodeBlock { 2; }
byLengths_5 = Cuboid.ByLengths(length=code_block_5)
list_create_3 = List.Create(item0=list_create, item1=byLengths_2, item2=list_create_2, item3=byLengths_4, item4=empty, item5=byLengths_5)
isEmpty = List.IsEmpty(list=list_create_3@L2)
filterByBoolMask = List.FilterByBoolMask(list=list_create_3, mask=isEmpty)
byUnion = Solid.ByUnion(solids=filterByBoolMask.out)
file_path = Filename("..\..\..\ProgramData\Autodesk\RVT 2025\Family Templates\English\Metric Generic Model.rft")
count = List.Count(list=byUnion)
code_block_6 = CodeBlock(x=count) { "Super Family " + (1..x); }
watch = Watch(code_block_6)
byGeometry = Custom[FamilyInstance.ByGeometry](geometry=byUnion, familyTemplatePath=file_path, familyName=watch)  # You must provide a valid family template path that will be used for all input geometry objects. The project units(and not the templates) will be used to determine the size of the output geometry. The provided category will be used only if the family template supports it. If not, the default template category will be used instead. Likewise, the family material(provided as a string) will be set only if a material with that name exists in the template. If not, the default material will be used instead ("By Category"). For void cuts, the material settings will be ignored. The Subcategory name is an optional input. If you'd like to skip assigning a Subcategory to any new instance, simply use null. The node expects a unique family name for each geometry object. The rest of the input lists will be processed as if the node lacing is set to longest.
watch_2 = Watch(byGeometry.family)
watch_3 = Watch(byGeometry.instance)
