# Dynamo graph springs2_TestSuite_B.dyn (Dynamo 2.0.2.6826)

springs_document = Custom[[springs] Document.CopyFromLinkInstance]()  # The node will use the total transformation of the link instance to copy the input elements into the local document.; unwired: LinkInstance, element
code_block = CodeBlock { Color.ByARGB(255, 1, 2, 3); }
springs_color_todecimal = Custom[[springs] Color.ToDecimal](color=code_block)  # Converts a Dynamo colour its Revit equivalent decimal value.
springs_decimal_tocolor = Custom[[springs] Decimal.ToColor](decimal=springs_color_todecimal)  # Converts a revit colour decimal value to its Dynamo equivalent.
equals = List.Equals(objectA=code_block, objectB=springs_decimal_tocolor)
levels = Levels(index=2)
code_block_2 = CodeBlock { "test"; "Gross Building"; }
springs_areaplan_bylevelname = Custom[[springs] AreaPlan.ByLevelName](level=levels, name=code_block_2.out0, schemeName=code_block_2.out1)  # Creates an area plan at the designated levels. Each new view needs a name. An area scheme must first be activated before it can be used. To activate a scheme, place one view of that type in the project(you can then delete it). If a view with the same scheme and name exists, you'll get a null instead.
type = Object.Type(obj=springs_areaplan_bylevelname)
code_block_3 = CodeBlock(t=type, e=springs_areaplan_bylevelname, n=code_block_2.out0)
# ---------- code_block_3.designscript (2 lines) ----------
t[0] == "Revit.Elements.Views.AreaPlanView"
  && e[0].Name == n;
# ----------------------------------------
code_block_4 = CodeBlock { 1000; }
byLengths = Cuboid.ByLengths(width=code_block_4, length=code_block_4, height=code_block_4)
code_block_5 = CodeBlock { "ds1"; "ds2"; }
springs_directshape_bygeometry = Custom[[springs] DirectShape.ByGeometry](geometry=byLengths, name=code_block_5.out0)  # Convert the input geometry to DirectShape element inside the Revit document. It supports solids or surfaces. It is based on an alternative process that uses a SAT import and can produce smooth surfaces. Each created DS will have a unique type. Make sure that each input geometry has a unique name. You can either feed a single category for all geometries or a unique category for each geometry - the node's lacing is set to longest by default. The default category is Generic Models.
code_block_6 = CodeBlock { Vector.ByCoordinates(1500); }
translate = Geometry.Translate(geometry=byLengths, direction=code_block_6)
code_block_7 = CodeBlock { Material.ByName("Glass"); }
springs_brepshape_bygeometry = Custom[[springs] BrepShape.ByGeometry](geometry=translate, name=code_block_5.out1, material=code_block_7)  # Convert the input geometry to DirectShape element inside the Revit document. Works only in Revit 2017 and later. Usies the more advanced BrepBuilder. It supports solids or surfaces, however periodic faces like spheres, cylinders and cones are not supported. Each created DS will have a unique type. Make sure that each input geometry has a unique name. You can either feed a single category and material for all geometries or a unique one for each geometry - the node's lacing is set to longest by default. The default category is Generic Model.
firstItem = List.FirstItem(list=springs_brepshape_bygeometry)
springs_directshape_translate = Custom[[springs] DirectShape.Translate](directShape=firstItem, vector=code_block_6)  # Copy the input DirectShape element with the help of a translation vector, similarly to the Geometry.Translate node. This method should prove more efficient than Element.Copy
firstItem_2 = List.FirstItem(list=springs_directshape_translate)
code_block_8 = CodeBlock { CoordinateSystem.ByOrigin(3000,0,0); }
springs_directshape_transform = Custom[[springs] DirectShape.Transform](directShape=firstItem_2, coordSystem=code_block_8)  # Transforms the typed DirectShape element from the identity coordinate system to the input coordinate system(s), in a manner similar to Dynamo's Geometry.Transform node.
code_block_9 = CodeBlock(ds1=springs_directshape_bygeometry, ds2=springs_brepshape_bygeometry, ds3=firstItem, ds4=springs_directshape_transform)
# ---------- code_block_9.designscript (4 lines) ----------
ds1[0] != null &&
ds2[0] != null &&
ds3[0] != null &&
ds4[0] != null;
# ----------------------------------------
springs_document_activeview = Custom[[springs] Document.ActiveView]()  # Selects the current document's active view. Supports more view types than the built-in option. Will be depreciated once the bult in node works with all plan types.
ꟿ_sheet_views = Custom[ꟿ Sheet.Views+](sheet=springs_document_activeview)  # Extracts all views and schedules (minus the revision schedule) placed on the input sheet (or sheets). Will be depreciated once the bult in node works with all plan types.
code_block_10 = CodeBlock(s=ꟿ_sheet_views.schedule_s) { s[0][0]; }
springs_document_2 = Custom[[springs] Document.CopyFromViewToView](sourceView=springs_document_activeview, destView=springs_document_activeview, elements=code_block_10)  # The node will copy the input (view based) elements from the source view into the destination view.
code_block_11 = CodeBlock(sched=springs_document_2) { sched[0] != 0; }
code_block_12 = CodeBlock { 1; }
springs_document_deleteelements = Custom[[springs] Document.DeleteElements](element=springs_document_2, confirm=code_block_12)  # Attempts to delete the input list of elements from the active Revit document.The node returns the number of successfully deleted elements and their Ids as a string. Carefully observe the deleted elements count. It may be greater than the input list because hosted elements or tags will be deleted as well. If an element in the list can not be deleted (for example last revision or last view), the whole list will fail to be deleted.
code_block_13 = CodeBlock(x=springs_document_deleteelements.count) { x == 1; }
ꟿ_document_centralpath = Custom[ꟿ Document.CentralPath]()  # If the document is workshared, the node returns the path to the central document as a string. Otherwise a null value will be returned.
ꟿ_form_bygeometry = Custom[ꟿ Form.ByGeometry]()  # Convert the input geometry to a Revit Form object. Forms can exist only in the family environment. You can convert complicated solids or surfaces directly into forms. A form can act as a void. Provide either one true boolean value to convert a form into a void. The node's lacing is set to longest by default.; unwired: geometry
ꟿ_element_iscutting = Custom[ꟿ Element.IsCutting]()  # Tests if the input element (or elements) is a void cut and if it is cutting any elements. In such cases, the cut elements will be provided.; unwired: element
ꟿ_element_iscut = Custom[ꟿ Element.IsCut]()  # Tests if the element is being cut by any void instances. If any cuts exist all cutting elements will be provided.; unwired: element
